# Grasshopper definition esfera.gh (Grasshopper 1.0.7)
# plug-ins: Triceratops, Bifocals

sph = Sphere(Base=PlaneXY(0, 0, 0), Radius=Slider(30, range=0..100))
basicmat = MeshBasicMaterial(Color=ColourSwatch(SwatchColor=RGB(23, 68, 232)))
mesh = Mesh(sph)
mesh_2 = Mesh(Mesh=mesh, Name="ejemplo", Material=basicmat, DecimalAccuracy=3)
nickname = RelativePath()
scene = CompileScene(Objects=mesh_2)
button = Button()
serialize = SerializeObject(Object3d=scene, Minify=False, Run=button)
concat = Concatenate(FragmentA=nickname, FragmentB="/www/assets")
concat_2 = Concatenate(FragmentA=nickname, FragmentB="/www")
http = HTTPServer(Path=concat_2, Run=Toggle(True))
writetxt = WriteTextFile(Path=concat, FileName="esfera.json", Data=serialize, Write=button)
